# Grasshopper definition CombinedEvaluation.ghx (Grasshopper 1.0.7)
# plug-ins: Geospatial

# ---- group: RH_IN:SiteGenerationJson
txt = Text()

# ---- group: RH_IN:BuildingGenerationJson
txt_2 = Text()

# ----
python = GhPythonScript(jsonstring=txt_2)  # -> out, RefKeys, ParcelOffset, SiteAccess, BuildingOffset, BuildingFootprint, BuildingStoreys
# ---------- python: Python ----------
__author__ = "Admin"
__version__ = "2023.03.07"

import rhinoscriptsyntax as rs
import ghpythonlib.treehelpers as th
import ghpythonlib.components as gh
import json


jsonobj = json.loads(jsonstring)
RefKeys = []
ParcelOffset = []
SiteAccess = []
BuildingOffset = []
BuildingFootprint = []
BuildingStoreys = []

for i in range(len(jsonobj.keys())):
    key = jsonobj.keys()[i]
    RefKeys.append(key)
    value = jsonobj[key]

    ParcelOffset.append([gh.PolyLine([gh.ConstructPoint(coord[0],coord[1],coord[2]) for coord in coordset],True) for coordset in value['ParcelOffset']])
    SiteAccess.append([gh.PolyLine([gh.ConstructPoint(coord[0],coord[1],coord[2]) for coord in coordset],True) for coordset in value['SiteAccess']])
    BuildingOffset.append([gh.PolyLine([gh.ConstructPoint(coord[0],coord[1],coord[2]) for coord in coordset],True) for coordset in value['BuildingOffset']])
    BuildingFootprint.append([gh.PolyLine([gh.ConstructPoint(coord[0],coord[1],coord[2]) for coord in coordset],True) for coordset in value['BuildingFootprint']])
    BuildingStoreys.append(value['BuildingStoreys'])

ParcelOffset = th.list_to_tree(ParcelOffset)
SiteAccess = th.list_to_tree(SiteAccess)
BuildingOffset = th.list_to_tree(BuildingOffset)
BuildingFootprint = th.list_to_tree(BuildingFootprint)
BuildingStoreys = th.list_to_tree(BuildingStoreys)
# ---------- end python ----------
python_2 = GhPythonScript(jsonstring=txt)  # -> out, RefKeys, ParcelBoundaries, ParcelEdgeCategories, ParcelBlockKeySelection, ParcelGPR
# ---------- python_2: Python ----------
__author__ = "Admin"
__version__ = "2023.03.07"

import rhinoscriptsyntax as rs
import ghpythonlib.treehelpers as th
import ghpythonlib.components as gh
import json

ParcelBoundaries = []
ParcelEdgeCategories = []
ParcelBlockKeySelection = []
ParcelGPR = []
jsonobj = json.loads(jsonstring)
RefKeys = []

for i in range(len(jsonobj.keys())):
    key = jsonobj.keys()[i]
    RefKeys.append(key)
    value = jsonobj[key]
    
    ParcelBoundaries.append([gh.PolyLine([gh.ConstructPoint(coords[0],coords[1],coords[2]) for coords in value['ParcelCoordinates']],True)])
    ParcelEdgeCategories.append(value['EdgeCategory'])
    ParcelBlockKeySelection.append(value['BKeySelection'])
    ParcelGPR.append([value['GPR']])


ParcelBoundaries = th.list_to_tree(ParcelBoundaries)
ParcelEdgeCategories = th.list_to_tree(ParcelEdgeCategories)
ParcelBlockKeySelection = th.list_to_tree(ParcelBlockKeySelection)
ParcelGPR = th.list_to_tree(ParcelGPR)
# ---------- end python_2 ----------
tstat = TreeStatistics(Tree=python.BuildingFootprint)  # -> Paths, Length, Count

multiplication = Multiplication(A=python.BuildingStoreys, B="3.5")
Z = UnitZ(Factor=multiplication)
srf = Surface(python.BuildingFootprint)
extr = Extrude(Base=srf, Direction=Z)

Z_2 = UnitZ(Factor="3.5")
arrlinear = LinearArray(Geometry=python.BuildingFootprint, Direction=Z_2, Count=python.BuildingStoreys)  # -> UnitFootprint3D, Transform

compute_cv = GhPythonScript(X=tstat.Length)  # -> G; inputs X: list of Int32
# ---------- compute_cv: Python ----------
__author__ = "Admin"
__version__ = "2023.03.09"

import rhinoscriptsyntax as rs

G = 0
for x in X:
    if x == 0:
        G += 1
# ---------- end compute_cv ----------
ew_aspect = EWAspect(brep=extr)  # -> R, colored_mesh
viewobstruction = ViewObstruction(planes=arrlinear.UnitFootprint3D)  # -> viewobstruction_per_parcel_2, colored_mesh
ma = MassAddition(Input=flatten(viewobstruction.viewobstruction_per_parcel_2))  # -> Result, PartialResults
avr = Average(Input=flatten(ew_aspect.R))
entwine = Entwine(Branch00=flatten(ew_aspect.colored_mesh), Branch01=flatten(viewobstruction.colored_mesh), FlattenInputs=True)  # -> simplify(Result)
merge = Merge(Data1=avr, Data2=ma.Result)
path = FilePath("C:\Users\Admin\Desktop\")  # disabled
panel = Panel("test4.txt")  # disabled
button = Button()  # disabled
fkeys = Panel("""MeanEWAspectRatio
TotalViewObstruction""")
python_3 = GhPythonScript(FKeys=fkeys, Scores=merge, Mesh=entwine, ConstraintViolation=compute_cv)  # -> out, jsonstring; inputs FKeys: list, Scores: list, Mesh: tree of Mesh
# ---------- python_3: Python ----------
__author__ = "Admin"
__version__ = "2023.03.09"

import rhinoscriptsyntax as rs
import ghpythonlib.components as gh
import Rhino
import json

def SerializeColor(color):
    return '#%02x%02x%02x' % (color.R,color.G,color.B)
    
options = Rhino.FileIO.DracoCompressionOptions()
options.CompressionLevel = 5;
options.IncludeTextureCoordinates = False;
options.IncludeVertexColors = True;

jsonobj = {}
jsonobj['ConstraintViolation'] = ConstraintViolation
jsonobj['Objectives'] = {}

for i in range(len(FKeys)):
    jsonobj['Objectives'][FKeys[i]] = {}
    jsonobj['Objectives'][FKeys[i]]['score']=Scores[i]
    
    jsonobj['Objectives'][FKeys[i]]['mesh'] = {}
    jsonobj['Objectives'][FKeys[i]]['mesh']['meshstring'] = [Rhino.FileIO.DracoCompression.Compress(uniquemesh,options).ToBase64String() for uniquemesh in Mesh.Branch(i)]
    jsonobj['Objectives'][FKeys[i]]['mesh']['color'] = [SerializeColor(uniquemesh.VertexColors[0]) for uniquemesh in Mesh.Branch(i)]

jsonstring = json.dumps(jsonobj)
# ---------- end python_3 ----------
write_file = WriteFile(Directory=path, Filename=panel, Data=python_3.jsonstring, Run=button)  # disabled

# ---- group: RH_OUT:CombinedEvaluationJson
txt_3 = Text(flatten(python_3.jsonstring))

# ==== cluster ViewObstruction
planes = ClusterInput()
brep = Brep(planes)
python = GhPythonScript(Planes=planes)  # -> out, a; inputs Planes: tree of Plane
# ---------- python: Python ----------
__author__ = "Admin"
__version__ = "2022.07.21"

import rhinoscriptsyntax as rs
import ghpythonlib.treehelpers as th
from Grasshopper.Kernel.Data import GH_Path
from Grasshopper import DataTree


dist = 50
storeyDict = {}
for plane in Planes.AllData():
    height = float(plane.Origin.Z)
    if height not in storeyDict:
        storeyDict[height] = []
    storeyDict[height].append(plane.Origin)

ans = []
geometryTree = DataTree[object]()

for blockbranch in Planes.Paths:
    storeyplanes = Planes.Branch(blockbranch)
    blockScore = []
    for storeyplane in storeyplanes:
        height = float(storeyplane.Origin.Z)
        count = 0
        for checkpt in storeyDict[height]:
            if rs.Distance(checkpt,storeyplane.Origin) < dist:
                count +=1
        blockScore.append(count-1)
    ans.append(blockScore)
    geometryTree.AddRange(blockScore, blockbranch)

a = th.list_to_tree(ans)
a = geometryTree
# ---------- end python ----------
bnd = Bounds(Numbers=flatten(python.a))
Z = UnitZ(Factor="3.5")
extr = Extrude(Base=brep, Direction=Z)
mesh = MeshBrep(
    Brep=extr,
    Settings={GridMaxCount=0, GridMinCount=16, JaggedSeams=False, MaxEdgeLength=0, MinEdgeLength=0.0001, MinTolerance=0, Refine=True, RefineAngle=0, RelativeTolerance=0.65, SimplePlanes=True, Tolerance=0})
dedomain = DeconstructDomain(Domain=bnd)  # -> Start, End
gradient = Gradient(
    LowerLimit=dedomain.Start,
    UpperLimit=dedomain.End,
    Parameter=python.a,
    stops=[0: RGB(0, 128, 0), 0.5: RGB(255, 255, 0), 1: RGB(255, 0, 0)])
trim = TrimTree(Tree=python.a, Depth=1)
viewobstruction_per_parcel = Number(trim)
mcol = MeshColours(Mesh=graft(mesh), Colours=graft(gradient))
trim_2 = TrimTree(Tree=mcol, Depth=1)
viewobstruction_per_parcel_2 = ClusterOutput(viewobstruction_per_parcel)
colored_mesh = ClusterOutput(trim_2)

# ==== cluster EWAspect
brep = ClusterInput()
brep_2 = Brep(brep)
bbox = BoundingBox(Content=brep_2, Plane=PlaneXY(0, 0, 0))  # -> Box, Box_2
smooth = SettingsQuality()
trim = TrimTree(Tree=bbox.Box, Depth=1)
boxprop = BoxProperties(Box=trim)  # -> Center, unitize(Diagonal), Area, Volume, Degeneracy
mesh = MeshBrep(Brep=brep_2, Settings=smooth)  # -> graft(Mesh)
devec = DeconstructVector(Vector=boxprop.Diagonal)  # -> XComponent, YComponent, ZComponent
division = Division(A=devec.YComponent, B=devec.XComponent)
gradient = Gradient(LowerLimit=0, UpperLimit="2", Parameter=division, stops=[0: RGB(0, 128, 0), 0.5: RGB(255, 255, 0), 1: RGB(255, 0, 0)])
graft = GraftTree(Tree=gradient, IncludeEmptyLists=True, IncludeNullItems=True)
mcol = MeshColours(Mesh=mesh, Colours=graft)
R = ClusterOutput(division)
trim_2 = TrimTree(Tree=mcol, Depth=1)
colored_mesh = ClusterOutput(trim_2)
